# Grasshopper definition a01_brep-mesher.ghx (Grasshopper 1.0.8)
# Copyright: Lorin Wiedemeier

srf_trim = Geometry(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)
rec = Rectangle({Plane=PlaneXY(2.722772277, 2.936704385, 0), Size=Domain2(u=-12.60254597..12.60254597, v=-8.343352192..8.343352192)})

# ----
# Brep Meshing
list = ValueList({"TriRemesh": "tri", "QuadRemesh": "quad", "HexaRemesh": "hexa"}, selected="HexaRemesh")
srf = Geometry(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)
py_compas = CompasPyTemplate(
    mesher_type=list,
    u_count=Slider(10, range=1..30),
    v_count=Slider(12, range=1..30),
    brep=srf_trim,
    full_faces=Toggle(True),
    closed=Toggle(True))  # -> mesh, geo; inputs mesher_type: String, u_count: Int32, v_count: Int32, brep: Brep
# ---------- py_compas: Python ----------
# r: compas==2.15.0,compas_timber==1.0.4
# venv: ca-fs26

from compas_rhino.devtools import DevTools
DevTools.ensure_path()
ghenv.Component.Message = "Mesher"

# ------ IMPORTS -------
from compas_rhino.conversions import mesh_to_rhino
# Import the class we just completed
from a01_mesher import QuadMesher, TriMesher

# --------------------------------------------------
# ------------------- EXECUTION --------------------

# Note: Ensure 'u_count', 'v_count', 'brep', and 'mesher_type' 
# are defined as inputs in your Grasshopper component.

mesher = None
compas_mesh = None

# Step 1: Instantiate the mesher based on the type
if mesher_type == "quad":
    # full_quads can be a toggle input in GH (defaulting to False)
    mesher = QuadMesher(u_count, v_count, brep,closed)
# CHALLENGE 02: If you created a TriMesher or other variants, add them here
#elif mesher_type == "hexa":
    #mesher = HexaMesher(u_count, v_count, brep, closed)
elif mesher_type == "tri":
    mesher = TriMesher(u_count,v_count, brep,closed)

edges = mesher.get_edges()


# Step 2: Generate the mesh
# This calls the logic that samples the surface and creates faces
mesh = mesher.generate_mesh()
compas_mesh = mesher.mesh
# Step 3: Prepare output
# 'mesh' is the COMPAS Mesh object (useful for further COMPAS processing)
# 'geo' is the Rhino Mesh geometry (to see it in the Rhino viewport)
mesh = compas_mesh
geo = mesh_to_rhino(compas_mesh)
# ---------- end py_compas ----------
geometry = Geometry(py_compas.geo)

srf_2 = Surface(rec)

# ----
# RF System
compas_mesh = Data(py_compas.mesh)
# A01 Brep Mesh
# Gramazio Kohler Research
# Gonzalo Casas, Lorin Wiedemeier, Eric Gozzi
py_compas_2 = CompasPyTemplate(mesh=compas_mesh, eccentricity=Slider(0.08, range=-1..1), extensions=Slider(0.07, range=-1..1))  # -> rf_system, mesh, centerlines; inputs eccentricity: Double
# ---------- py_compas_2: Python ----------
# r: compas==2.15.0,compas_timber==1.0.4
# venv: ca-fs26

from compas_rhino.devtools import DevTools
DevTools.ensure_path()
ghenv.Component.Message = "RF Datastracture and lines"

# ------ IMPORTS -------

from a01_rf_system import RFSystem

# --------------------------------------------------
# ------------------- EXECUTION --------------------

# MAIN TASK:
# Step 1: create an rf system from mesh
rf_system = RFSystem(mesh)

# Step 2: create RF datastructure
rf_system.create_rf_datastructure()

# Step 3: eccentrize and extend center lines
rf_system.eccentrize_centerlines(eccentricity)
rf_system.extend_centerlines(eccentricity)

# Step 4: Prepare output
centerlines = rf_system.centerlines
mesh = rf_system.mesh
# ---------- end py_compas_2 ----------
draw = COMPASDraw(cg=py_compas_2.centerlines)  # -> rg
#   port cg: The COMPAS geometry or datastructure to be drawn.
#   port rg: The Rhino geometry object.
# ---------- draw: Python ----------
# r: compas==2.15.0,compas_timber==1.0.4
# venv: ca-fs26

from typing import Any

import Grasshopper

from compas.scene import SceneObject


class CompasToRhinoGeometry(Grasshopper.Kernel.GH_ScriptInstance):
    def RunScript(self, cg):
        if not cg:
            return None

        return SceneObject(item=cg).draw()
# ---------- end draw ----------

# ----
# Timber Model
dam = DataDam(DataA=py_compas_2.rf_system, BufferDelay=10000000, BufferMode=0)
py_compas_3 = CompasPyTemplate(
    rf_system=dam,
    process_joinery=Toggle(True),
    beam_width=Slider(0.08, range=0..0.2),
    beam_height=Slider(0.1, range=0..0.2),
    tolerance=Slider(0.12, range=0..0.5))  # -> timber_model, beams, joining_errors
# ---------- py_compas_3: Python ----------
# r: compas==2.15.0,compas_timber==1.0.4
# venv: ca-fs26

from compas_rhino.devtools import DevTools
import compas_timber
DevTools.ensure_path()
ghenv.Component.Message = "Timber model"
print(compas_timber.__version__)

# -------------------- IMPORTS ---------------------

from a01_timber_model import TimberModelCreator

# ------------------- EXECUTION --------------------

# Copy the RF system on start, because that's the way Grasshopper always behaves
rf_system = rf_system.copy()

# Initialize creator
creator = TimberModelCreator(rf_system, beam_width, beam_height, tolerance=tolerance)

# Create model and apply joints
timber_model = creator.create_timber_model(process_joinery=process_joinery)
joining_errors = creator.joining_errors

if len(joining_errors):
    ghenv.Component.Message = f"Found {len(joining_errors)} joining errors!"

# Output geometry
beams = []
for beam in timber_model.beams:
    beams.append(beam.geometry)
# ---------- end py_compas_3 ----------
draw_2 = COMPASDraw(cg=py_compas_3.beams)  # -> rg; same code as draw
wires = BrepWireframe(Brep=draw_2, Density=-1)
preview = CustomPreview(Geometry=draw_2, Material=ColourSwatch(SwatchColor=RGBA(214, 188, 139, 144)))
preview_2 = CustomPreview(Geometry=wires, Material=ColourSwatch(SwatchColor=RGB(0, 0, 0)))

reloader = CompasDevReloader()
# ---------- reloader: Python ----------
"""
------------------------------
Using VS Code as Python editor
------------------------------

The simplest way to start using VS Code as our editor, is
to place our Python code in files located IN THE SAME FOLDER as our Grasshopper file.

After we have done that, we need 2 steps: 

1. Enable the COMPAS reloader on one component. This tells Grasshopper to watch for changes in the Pythoh files and reload if changed.
2. Every other component that uses Python code from external files needs to start with a method to ensure Grasshopper knows where to load the files from.

"""
# r: compas==2.15.0,compas_timber==1.0.4
# venv: ca-fs26

from compas_rhino.devtools import DevTools
DevTools.enable_reloader()
# ---------- end reloader ----------
