# Grasshopper definition Zhao_Wanru_A-02.ghx (Grasshopper 1.0.8)
# Copyright: Lorin Wiedemeier

srf_trim = Geometry(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)

# ----
# Brep Meshing
list = ValueList({"TriRemesh": "tri", "QuadRemesh": "quad", "HexaRemesh": "hexa"}, selected="QuadRemesh")
srf = Geometry(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)
# Modifiers
toggle = BooleanToggle(True)
py_compas = CompasPyTemplate(mesher_type=list, u_count=Slider(12, range=1..30), v_count=Slider(12, range=1..30), brep=srf_trim, full_faces=toggle)  # -> mesh, goals, geo; inputs mesher_type: String, u_count: Int32, v_count: Int32, brep: Brep
# ---------- py_compas: Python ----------
# r: compas==2.15.0,compas_timber==1.0.4
# venv: ca-fs26

from compas_rhino.devtools import DevTools
DevTools.ensure_path()
ghenv.Component.Message = "Mesher"

# ------ IMPORTS -------

from compas_rhino.conversions import mesh_to_rhino
from a02_mesh_relax import MeshRelaxerGoals

# Import meshers
from a02_mesher import QuadMesher
from a02_mesher import TriMesher
from a02_mesher import HexaMesher
# Add other imports if you implemented new classes
# from a02_mesher import ...

# --------------------------------------------------
# ------------------- EXECUTION --------------------
mesher = None
compas_mesh = None

if mesher_type == "quad":
    mesher = QuadMesher(u_count, v_count, brep, full_quads = full_faces)

elif mesher_type == "tri":
    mesher = TriMesher(u_count=u_count, v_count=v_count, brep=brep)

elif mesher_type == "hexa":
    mesher = HexaMesher(u_count=u_count, v_count=v_count, brep=brep)
# if you added one or more variants of meshing, create the instances here
# elif mesher_type ...
# ...

mesher.generate_mesh()
goals = MeshRelaxerGoals.from_brep(brep)

mesh = mesher.mesh
geo = mesh_to_rhino(mesh, disjoint=False)
# ---------- end py_compas ----------
geometry = Geometry(py_compas.geo)
mesh = Data(py_compas.mesh)
goals = Data(py_compas.goals)

attractor_point = Point(<point referenced from the Rhino model>)
py_compas_2 = CompasPyTemplate(point=attractor_point)  # -> modifier; inputs point: Point3d
# ---------- py_compas_2: Python ----------
# r: compas==2.15.0,compas_timber==1.0.4
# venv: ca-fs26

from compas_rhino.devtools import DevTools
from compas.geometry import Point, Vector
DevTools.ensure_path()
ghenv.Component.Message = "CHALLENGE 02: Modifiers"

# ------ IMPORTS -------

from compas_rhino.conversions import point_to_compas
from compas_rhino.conversions import mesh_to_compas

# 1. Import your modifier class
# from a02_modifiers import ...
from a02_modifiers import AttractorPointModifier
from a02_mesh_relax import MeshRelaxer
# --------------------------------------------------
# ------------------- EXECUTION --------------------

# 2. Create an instance of the class, passing all data you require
#    NOTE: Remember to apply conversions from Rhino to COMPAS where needed
# modifier = ...

modifier = AttractorPointModifier(
    point=Point(point[0], point[1], point[2]), 
    force=0.01
)
# ---------- end py_compas_2 ----------

# ---- group: Modifiers
merge = Merge(Data1=py_compas_2)

# ----
modifiers = Data(merge)

# ----
# Mesh Relaxation
mesh_2 = Data(mesh)
goals_2 = Data(goals)
# A02 Mesh Relax
# Gramazio Kohler Research
# Gonzalo Casas, Lorin Wiedemeier, Eric Gozzi
py_compas_3 = CompasPyTemplate(
    mesh=mesh_2,
    damping=Slider(0.15, range=0..0.5),
    goals=goals_2,
    modifiers=modifiers,
    snap_to_surface=Toggle(True),
    reset=Button(),
    on=Toggle(True))  # -> relaxed_mesh, iteration; inputs damping: Double, modifiers: list, snap_to_surface: Boolean, reset: Boolean, on: Boolean
# ---------- py_compas_3: Python ----------
# r: compas==2.15.0,compas_timber==1.0.4
# venv: ca-fs26

from compas_rhino.devtools import DevTools
DevTools.ensure_path()

# ------ IMPORTS -------

import scriptcontext as sc
import Grasshopper as gh

from compas_ghpython import create_id
from compas_ghpython.timer import update_component

from a02_mesh_relax import MeshRelaxer

# --------------------------------------------------
# ------------------- EXECUTION --------------------

key = create_id(ghenv.Component, "relaxer")

# 1. Initialize or Reset
if reset or key not in sc.sticky:
    relaxer = MeshRelaxer(mesh.copy(), iterations=1)

    sc.sticky[key] = relaxer
    ghenv.Component.Message = "Mesh Relaxer Ready"

# 2. Retrieve state
relaxer = sc.sticky[key]

# 3. Update live parameters
relaxer.damping = damping
relaxer.goals = goals
relaxer.snap_to_surface = snap_to_surface
relaxer.modifiers = modifiers or []

# 4. Run step
if on:
    relaxer.relax()

    ghenv.Component.Message = f"Mesh Relaxer\nIteration #{relaxer.step}"
    update_component(ghenv, 20)

relaxed_mesh = relaxer.mesh
# ---------- end py_compas_3 ----------
draw = COMPASDraw(cg=py_compas_3.relaxed_mesh)  # -> rg
#   port cg: The COMPAS geometry or datastructure to be drawn.
#   port rg: The Rhino geometry object.
# ---------- draw: Python ----------
# r: compas==2.15.0,compas_timber==1.0.4
# venv: ca-fs26
"""
Draws COMPAS geometry in Grasshopper.
"""

from typing import Any

import Grasshopper

from compas.scene import SceneObject


class CompasToRhinoGeometry(Grasshopper.Kernel.GH_ScriptInstance):
    def RunScript(self, cg):
        if not cg:
            return None

        return SceneObject(item=cg).draw()
# ---------- end draw ----------
dam = DataDam(DataA=py_compas_3.relaxed_mesh, BufferDelay=10000000, BufferMode=0)

panel = Panel(merge)

mesh_analysis = Data(py_compas_3.relaxed_mesh)
py_compas_4 = CompasPyTemplate(mesh=mesh_analysis, f_index=Slider(27, range=0..100), e_index=Slider(0, range=0..6))  # inputs f_index: Int32, e_index: Int32
# ---------- py_compas_4: Python ----------
"""Grasshopper Script Instance"""
import System
import Rhino
import Rhino.Geometry
import Grasshopper

from compas_rhino.conversions import point_to_rhino

class MyComponent(Grasshopper.Kernel.GH_ScriptInstance):

    def RunScript(self, mesh, f_index: int, e_index: int):
        """
        Inputs:
            mesh: compas.datastructures.Mesh
            f_index: int (Face Index)
            e_index: int (Edge Index)
        """
        ghenv.Component.Message = "Topo Explorer"
        
        # --- Storage for Draw ---
        self._lines = []        
        self._main_labels = []  # Navigation labels (Selected, Next, etc.)
        self._index_labels = [] # Face-local edge indices
        self._global_dots = []  # Global Face and Vertex indices
        
        if not mesh:
            return

        # ------------------------------------------------
        # 0. DRAW ALL MESH EDGES (Background Wireframe)
        # ------------------------------------------------
        wire_color = System.Drawing.Color.FromArgb(180, 180, 180) 
        
        for u, v in mesh.edges():
            p_u = point_to_rhino(mesh.vertex_attributes(u, 'xyz'))
            p_v = point_to_rhino(mesh.vertex_attributes(v, 'xyz'))
            self._lines.append((Rhino.Geometry.Line(p_u, p_v), wire_color, 1))

        # ------------------------------------------------
        # 1. GLOBAL VISUALIZATION 
        # ------------------------------------------------
        for fkey in mesh.faces():
            pt = mesh.face_centroid(fkey)
            self._global_dots.append((str(fkey), point_to_rhino(pt), System.Drawing.Color.Blue, 35))
            
        for vkey in mesh.vertices():
            pt = mesh.vertex_point(vkey)
            self._global_dots.append((str(vkey), point_to_rhino(pt), System.Drawing.Color.Magenta, 30))

        # ------------------------------------------------
        # 2. TOPO NAVIGATION LOGIC
        # ------------------------------------------------
        def get_face_centroid(f_key):
            pts = [mesh.vertex_attributes(v, 'xyz') for v in mesh.face_vertices(f_key)]
            c = [sum(axis)/len(axis) for axis in zip(*pts)]
            return point_to_rhino(c)

        def add_face_indices(f_key, color):
            center = get_face_centroid(f_key)
            vertices = mesh.face_vertices(f_key)
            for i in range(len(vertices)):
                p_u = point_to_rhino(mesh.vertex_attributes(vertices[i], 'xyz'))
                p_v = point_to_rhino(mesh.vertex_attributes(vertices[(i + 1) % len(vertices)], 'xyz'))
                mid = (p_u + p_v) / 2.0
                vec_to_center = center - mid
                text_loc = mid + (vec_to_center * 0.15)
                self._index_labels.append((str(i), text_loc, color, 22))

        if f_index is not None and e_index is not None:
            try:
                f_keys = list(mesh.faces())
                if f_index >= len(f_keys): raise IndexError
                f_key = f_keys[f_index]
                
                f_vtx = mesh.face_vertices(f_key)
                if e_index >= len(f_vtx):
                    self.AddRuntimeMessage(Grasshopper.Kernel.GH_RuntimeMessageLevel.Warning, "Edge Index out of range")
                else:
                    # Highlight active face indices
                    add_face_indices(f_key, System.Drawing.Color.DarkGreen)

                    # --- A. Selected Edge (Black) ---
                    u, v = f_vtx[e_index], f_vtx[(e_index + 1) % len(f_vtx)]
                    p1, p2 = point_to_rhino(mesh.vertex_attributes(u, 'xyz')), point_to_rhino(mesh.vertex_attributes(v, 'xyz'))
                    
                    self._lines.append((Rhino.Geometry.Line(p1, p2), System.Drawing.Color.Black, 6))
                    self._main_labels.append(("*Selected*", (p1+p2)/2, System.Drawing.Color.Black, 24))

                    # --- B. Next Edge (Blue) ---
                    w = f_vtx[(e_index + 2) % len(f_vtx)]
                    p3 = point_to_rhino(mesh.vertex_attributes(w, 'xyz'))
                    
                    self._lines.append((Rhino.Geometry.Line(p2, p3), System.Drawing.Color.DodgerBlue, 4))
                    # Added Label Here:
                    self._main_labels.append(("Next Edge", (p2+p3)/2, System.Drawing.Color.DodgerBlue, 20))
                    
                    # --- C. Previous Edge (Red) ---
                    adj_face = mesh.halfedge_face((v, u))
                    if adj_face is not None:
                        add_face_indices(adj_face, System.Drawing.Color.DarkRed)
                        adj_vtx = mesh.face_vertices(adj_face)
                        if u in adj_vtx:
                            u_idx = adj_vtx.index(u)
                            z = adj_vtx[(u_idx + 1) % len(adj_vtx)]
                            p_z = point_to_rhino(mesh.vertex_attributes(z, 'xyz'))
                            
                            self._lines.append((Rhino.Geometry.Line(p1, p_z), System.Drawing.Color.Red, 4))
                            # Renamed Label Here:
                            self._main_labels.append(("Prev. Edge", (p1+p_z)/2, System.Drawing.Color.Red, 20))
                    else:
                        self._main_labels.append(("Boundary", (p1+p2)/2, System.Drawing.Color.Gray, 18))
            
            except IndexError:
                self.AddRuntimeMessage(Grasshopper.Kernel.GH_RuntimeMessageLevel.Warning, "Face Index out of range")

        return None

    def IsPreviewCapable(self):
        return Grasshopper.Kernel.GH_PreviewCapability.Disabled

    def DrawViewportWires(self, args):
        if hasattr(self, "_lines"):
            for line, color, thickness in self._lines:
                args.Display.DrawLine(line, color, thickness)

    def DrawViewportMeshes(self, args):
        # 1. Global Face/Vertex Indices
        if hasattr(self, "_global_dots"):
            for text, pt, color, size in self._global_dots:
                args.Display.Draw2dText(text, color, pt, True, size)
        
        # 2. Local Edge Indices (0, 1, 2...)
        if hasattr(self, "_index_labels"):
            for text, pt, color, size in self._index_labels:
                args.Display.Draw2dText(text, color, pt, True, size)

        # 3. Navigation Status Labels
        if hasattr(self, "_main_labels"):
            for text, pt, color, size in self._main_labels:
                args.Display.Draw2dText(text, color, pt, True, size)

    def AfterRunScript(self):
        self.MaintainDrawSettings = True
# ---------- end py_compas_4 ----------

panel_2 = Panel(dam)
python_3_script = Python3Script(mesh=dam)  # -> welded_mesh
# ---------- python_3_script: Python ----------
from compas.tolerance import TOL
from compas.datastructures import Mesh
from itertools import tee

def pairwise(iterable):
    a, b = tee(iterable)
    next(b, None)
    return zip(a, b)

def mesh_weld(mesh, precision=3):

    geo = TOL.geometric_key

    vertex_xyz = {vertex: mesh.vertex_coordinates(vertex) for vertex in mesh.vertices()}
    gkey_vertex = {geo(xyz, precision): vertex for vertex, xyz in vertex_xyz.items()}
    gkey_index = {gkey: index for index, gkey in enumerate(gkey_vertex)}

    vertices = [vertex_xyz[vertex] for gkey, vertex in gkey_vertex.items()]
    faces = []
    for face in mesh.faces():
        indices = []
        for vertex in mesh.face_vertices(face):
            gkey = geo(vertex_xyz[vertex], precision)
            indices.append(gkey_index[gkey])
        faces.append(indices)

    faces[:] = [[u for u, v in pairwise(indices + indices[:1]) if u != v] for indices in faces]
    faces[:] = [indices for indices in faces if len(indices) > 2]

    mesh = Mesh.from_vertices_and_faces(vertices, faces)
    return mesh

welded_mesh = mesh_weld(mesh, 3)
# ---------- end python_3_script ----------
panel_3 = Panel(python_3_script)
draw_2 = COMPASDraw(cg=python_3_script)  # -> rg; same code as draw

# ----
# RF System
compas_mesh = Data(python_3_script)
py_compas_5 = CompasPyTemplate(
    mesh=compas_mesh,
    attractor_point=attractor_point,
    attractor_factor=Slider(0.02, range=0..1),
    eccentricity=Slider(-0.282, range=-1..1),
    extensions=Slider(0.07, range=-1..1))  # -> rf_system, mesh, centerlines; inputs attractor_point: Point3d, attractor_curve: Curve, eccentricity: Double
# ---------- py_compas_5: Python ----------
# r: compas==2.15.0,compas_timber==1.0.4
# venv: ca-fs26

from compas_rhino.devtools import DevTools
DevTools.ensure_path()
ghenv.Component.Message = "RF Datastracture and lines"

# ------ IMPORTS -------
import scriptcontext as sc
import Grasshopper as gh

from compas.datastructures import Mesh
from compas_ghpython import create_id
from compas_ghpython.timer import update_component
from compas_rhino.conversions import mesh_to_rhino
from compas_rhino.conversions import point_to_compas
from a02_rf_system import RFSystem

# --------------------------------------------------
# ------------------- EXECUTION --------------------

rf_system = RFSystem(mesh)

rf_system.create_rf_datastructure()

# CHALLENGE 01: Generate eccentricity of centerlines
# Option 1: basic eccentricity based on parameter
# ----------------------------------------------
#rf_system.eccentrize_centerlines(eccentricity)

# Option 2: eccentricity based on attractor point
# ----------------------------------------------
attractor_point = point_to_compas(attractor_point)
rf_system.eccentrize_centerlines_attractor_point(attractor_point, attractor_factor)

# Option 3: eccentricy based on attractor curves
# ----------------------------------------------
# attractor_curve = curve_to_compas(attractor_curve)
# rf_system.eccentrize_centerlines_attractor_curve(attractor_curve, attractor_factor)

rf_system.extend_centerlines(extensions)

centerlines = rf_system.centerlines
mesh = rf_system.mesh
# ---------- end py_compas_5 ----------
draw_3 = COMPASDraw(cg=py_compas_5.centerlines)  # -> rg
#   port cg: The COMPAS geometry or datastructure to be drawn.
#   port rg: The Rhino geometry object.
# ---------- draw_3: Python ----------
# r: compas==2.15.0,compas_timber==1.0.4
# venv: ca-fs26

from typing import Any

import Grasshopper

from compas.scene import SceneObject


class CompasToRhinoGeometry(Grasshopper.Kernel.GH_ScriptInstance):
    def RunScript(self, cg):
        if not cg:
            return None

        return SceneObject(item=cg).draw()
# ---------- end draw_3 ----------

deconstruct_mesh = DeconstructMesh(Mesh=draw_2)  # -> flatten(Vertices), Faces, Colours, Normals
python_3_script_2 = Python3Script(x=deconstruct_mesh.Vertices)  # -> out, a; inputs x: list of Vector3d
# ---------- python_3_script_2: Python ----------
import math

for idx_i, i in enumerate(x[:-1]):
    for j in x[idx_i+1:]:
        if math.sqrt((i[0]-j[0])**2 + (i[1]-j[1])**2 + (i[2]-j[2])**2) < 1e-2:
            print (idx_i)
            break
# ---------- end python_3_script_2 ----------
panel_4 = Panel(python_3_script_2.out)

# ----
# Timber Model
dam_2 = DataDam(DataA=py_compas_5.rf_system, BufferDelay=10000000, BufferMode=0)
py_compas_6 = CompasPyTemplate(
    rf_system=dam_2,
    process_joinery=Toggle(True),
    beam_width=Slider(0.08, range=0..0.2),
    beam_height=Slider(0.1, range=0..0.2),
    tolerance=Slider(0.85, range=0..3))  # -> timber_model, beams, joining_errors
# ---------- py_compas_6: Python ----------
# r: compas==2.15.0,compas_timber==1.0.4
# venv: ca-fs26

from compas_rhino.devtools import DevTools
DevTools.ensure_path()
ghenv.Component.Message = "Timber model"

# -------------------- IMPORTS ---------------------

from a02_timber_model import TimberModelCreator

from compas.tolerance import TOL
print(TOL.absolute)

TOL.absolute = 1e-3
# ------------------- EXECUTION --------------------

# Copy the RF system on start, because that's the way Grasshopper always behaves
rf_system = rf_system.copy()

# Initialize creator
creator = TimberModelCreator(rf_system, beam_width, beam_height, tolerance=tolerance)

# Create model and apply joints
timber_model = creator.create_timber_model(process_joinery=process_joinery)
print(timber_model)
joining_errors = creator.joining_errors

if len(joining_errors):
    ghenv.Component.Message = f"Found {len(joining_errors)} joining errors!"

# Output geometry
beams = []
geometry_errors = []
for beam in timber_model.beams:
    try:
        beams.append(beam.geometry)
    except Exception as e:
        geometry_errors.append(e)
        print(f"Could you add geometry of beam: {e}")

if len(geometry_errors) > 0:
    ghenv.Component.Message = f"{len(geometry_errors)} beams failed to generate geometry!"
# ---------- end py_compas_6 ----------
draw_4 = COMPASDraw(cg=py_compas_6.beams)  # -> rg; same code as draw_3
wires = BrepWireframe(Brep=draw_4, Density=-1)
preview = CustomPreview(Geometry=draw_4, Material=ColourSwatch(SwatchColor=RGBA(214, 188, 139, 144)))
preview_2 = CustomPreview(Geometry=wires, Material=ColourSwatch(SwatchColor=RGB(0, 0, 0)))

reloader = CompasDevReloader()
# ---------- reloader: Python ----------
"""
------------------------------
Using VS Code as Python editor
------------------------------

The simplest way to start using VS Code as our editor, is
to place our Python code in files located IN THE SAME FOLDER as our Grasshopper file.

After we have done that, we need 2 steps: 

1. Enable the COMPAS reloader on one component. This tells Grasshopper to watch for changes in the Pythoh files and reload if changed.
2. Every other component that uses Python code from external files needs to start with a method to ensure Grasshopper knows where to load the files from.

"""
# r: compas==2.15.0,compas_timber==1.0.4
# venv: ca-fs26

from compas_rhino.devtools import DevTools
DevTools.enable_reloader()
# ---------- end reloader ----------

# ---- group: 2. Set file name
mustermann_max = Panel("Zhao Wanru")
assignment_nr = Panel("A02_")

# ---- group: 4. Set display options
toggle_2 = BooleanToggle(True)
toggle_3 = BooleanToggle(True)

# ---- group: 5. Click button to save image
button = Button()

# ---- group: 3. Set image dimensions
width = Panel("3200")
height = Panel("2400")

# ---- group: 1. Select target directory
path = FilePath("/Users/leona/Desktop/coding_architecture_fs26/Coding Architecture II/Assignment_A02/Zhao_Wanru_A02_02")

# ----
python = Python3Script(
    path=path,
    name=mustermann_max,
    assignment_nr=assignment_nr,
    width=width,
    height=height,
    display_grid=toggle_2,
    display_grid_axes=toggle_3,
    save=button)  # -> out; inputs path: String, name: String, assignment_nr: String, width: Int32, height: Int32
# ---------- python: Python ----------
# r: compas
# venv: ca-hs25

import Rhino.Display as rd
import scriptcontext as sc
import System
import os

file_name = name + "_" + assignment_nr

def get_next_index(path):
    index = 1
    while os.path.exists(path + file_name + str(index) + ".png"):
        index += 1
    return index

def ViewCaptureToFile(path):
    view = sc.doc.Views.ActiveView
    if view:
        view_capture = rd.ViewCapture()
        view_capture.TransparentBackground = False
        view_capture.Width = view.ActiveViewport.Size.Width
        view_capture.Height = view.ActiveViewport.Size.Width
        view_capture.ScaleScreenItems = False
        view_capture.DrawAxes = True
        view_capture.DrawGrid = display_grid
        view_capture.DrawGridAxes = display_grid_axes
        size = System.Drawing.Size(view_capture.Width, view_capture.Height)
        size = System.Drawing.Size(width, height)
        
        settings = rd.ViewCaptureSettings(view, size, 72) # view, size, dpi
        settings.RasterMode = True
        settings.DrawGrid = display_grid
        settings.DrawAxis = display_grid_axes
        settings.DrawWallpaper = False
        index = get_next_index(path)
            
        filename = file_name + str(index)
        filename_with_extension = filename + ".png"
        bitmap = rd.ViewCapture.CaptureToBitmap.__overloads__[rd.ViewCaptureSettings](settings)
        fullpath = path + filename_with_extension
        bitmap.Save(fullpath)
        
        return filename_with_extension
        
        
if path is None:
    ghenv.Component.Message = "Please select a target directory first"
else:
    if save:
        path = ViewCaptureToFile(path)
        ghenv.Component.Message = "Saved image to " + path
# ---------- end python ----------
