# Grasshopper definition a00_compas-timber_starting_point.ghx (Grasshopper 1.0.8)

# ----
# COMPAS Timber - Direct Joint
# Direct Joint Assignments
curve = Curve([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])
ct_model = Python3Script(lines=curve)  # -> geo; inputs lines: list of Line
# ---------- ct_model: Python ----------
# r: compas==2.15.0,compas_timber==1.0.4
# venv: ca-fs26

from compas_rhino.conversions import line_to_compas
from compas_timber.connections import XLapJoint
from compas_timber.elements import Beam
from compas_timber.model import TimberModel

# 1. Define dimensions and orientation
width = 0.06    
height = 0.08
z_vector = (0,0,1)

# 2. Create the TimberModel
model = TimberModel()

# 3. Loop through input lines and create Beams
for line in lines:
    # Convert Rhino line to COMPAS line
    line = line_to_compas(line)

    # Create a Beam from the line
    beam = Beam.from_centerline(line, width, height, z_vector)
    
    # Add beam to model
    model.add_element(beam)

# 4. Create Joints manually between specific beams
beams = list(model.beams)
# Joint between first and second beam, then second and third, then third and first
XLapJoint.create(model, beams[0], beams[1])
XLapJoint.create(model, beams[1], beams[2])
XLapJoint.create(model, beams[2], beams[0])

# 5. Process the joinery (calculate geometry)
model.process_joinery()

# 6. Extract geometry for visualization
geo = []
for beam in model.beams:
    geo.append(beam.geometry)
# ---------- end ct_model ----------
# exercise
compas_draw = COMPASDraw(cg=ct_model)  # -> rg
#   port cg: The COMPAS geometry or datastructure to be drawn.
#   port rg: The Rhino geometry object.
# ---------- compas_draw: Python ----------
# r: compas==2.15.0,compas_timber==1.0.4
# venv: ca-fs26
"""
Draws COMPAS geometry in Grasshopper.
"""

from typing import Any

import Grasshopper

from compas.scene import SceneObject


class CompasToRhinoGeometry(Grasshopper.Kernel.GH_ScriptInstance):
    def RunScript(self, cg):
        if not cg:
            return None

        return SceneObject(item=cg).draw()
# ---------- end compas_draw ----------

# ----
# COMPAS Timber - Joint Rules
# Direct Rules
lines = Curve([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])
ct_model_2 = Python3Script(lines=lines)  # -> geo; inputs lines: list of Line
# ---------- ct_model_2: Python ----------
# r: compas==2.15.0,compas_timber==1.0.4
# venv: ca-fs26

from compas_rhino.conversions import line_to_compas
from compas_timber.connections import XLapJoint, TButtJoint, LMiterJoint, JointTopology
from compas_timber.elements import Beam
from compas_timber.model import TimberModel

from compas_timber.design import DirectRule, JointRuleSolver, TopologyRule, CategoryRule

width = 0.06
height = 0.08
z_vector = (0, 0, 1)

# ---------- TIMBER MODEL WITH DIRECT RULE-ASSIGNMENT ---------- #

model = TimberModel()

for line in lines:
    line = line_to_compas(line)
    beam = Beam.from_centerline(centerline=line, width=width, height=height, z_vector=z_vector)
    model.add_element(beam)

beams = list(model.beams)
# Direct rule assignment for specific beams
rules = [
    DirectRule(XLapJoint, [beams[0], beams[1]]),
    DirectRule(XLapJoint, [beams[1], beams[2]]),
    DirectRule(XLapJoint, [beams[2], beams[0]])
]

solver = JointRuleSolver(rules)
solver.apply_rules_to_model(model)

model.process_joinery()

geo = [beam.geometry for beam in model.beams]
# ---------- end ct_model_2 ----------
# example
compas_draw_2 = COMPASDraw(cg=ct_model_2)  # -> rg; same code as compas_draw

# ----
# Categories
lines_a = Curve([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])
lines_b = Curve([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])
ct_model_3 = Python3Script(lines_a=lines_a, category_a="outer", lines_b=lines_b, category_b="inner")  # -> geo; inputs lines_a: list of Line, category_a: String, lines_b: list of Line, category_b: String
# ---------- ct_model_3: Python ----------
# r: compas==2.15.0,compas_timber==1.0.4
# venv: ca-fs26

from compas_rhino.conversions import line_to_compas
from compas_timber.connections import XLapJoint, TButtJoint, LButtJoint
from compas_timber.elements import Beam
from compas_timber.model import TimberModel

from compas_timber.design import DirectRule, JointRuleSolver, TopologyRule, CategoryRule

width = 0.06
height = 0.08
z_vector = (0, 0, 1)

# ---------- RULE-BASED TIMBER MODEL WITH JOINTS ---------- #

model = TimberModel()

# lines_a, lines_b, category_a, category_b are provided as inputs
for line in lines_a:
    beam = Beam.from_centerline(line_to_compas(line), width, height, z_vector=z_vector)
    beam.attributes["category"] = category_a
    model.add_element(beam)

for line in lines_b:
    beam = Beam.from_centerline(line_to_compas(line), width, height, z_vector=z_vector)
    beam.attributes["category"] = category_b
    model.add_element(beam)

# Define rule for joints between category_a and category_b
rule1 = CategoryRule(TButtJoint, category_b, category_a)
rule2 = CategoryRule(XLapJoint, category_b, category_b)
rule3 = CategoryRule(LButtJoint, category_a, category_a)

# Use JointRuleSolver to apply rules
solver = JointRuleSolver([rule1, rule2, rule3])
solver.apply_rules_to_model(model)

model.process_joinery()

geo = [beam.geometry for beam in model.beams]
# ---------- end ct_model_3 ----------
# example
compas_draw_3 = COMPASDraw(cg=ct_model_3)  # -> rg; same code as compas_draw

# ----
# Topology
lines_a_2 = Curve([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])
lines_b_2 = Curve([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])
ct_model_4 = Python3Script(lines=[lines_a_2, lines_b_2])  # -> geo; inputs lines: list of Line
# ---------- ct_model_4: Python ----------
# r: compas==2.15.0,compas_timber==1.0.4
# venv: ca-fs26

from compas_rhino.conversions import line_to_compas
from compas_timber.connections import XLapJoint, TButtJoint, LMiterJoint, JointTopology
from compas_timber.elements import Beam
from compas_timber.model import TimberModel

from compas_timber.design import DirectRule, JointRuleSolver, TopologyRule, CategoryRule

# 1. Define dimensions
width = 0.06
height = 0.08
z_vector = (0,0,1)

# ----------- TOPOLOGICAL RULE-BASED TIMBER MODEL WITH JOINTS ---------- #

# 2. Initialize TimberModel and Beams
model = TimberModel()
for line in lines:
    line = line_to_compas(line)
    beam = Beam.from_centerline(centerline=line, width=width, height=height, z_vector=z_vector)
    model.add_element(beam)

# 3. Define Topological Rules
# Instead of specific pairs, we define rules for intersection types (X, T, L)
rules = [
    TopologyRule(JointTopology.TOPO_X, XLapJoint),
    TopologyRule(JointTopology.TOPO_T, TButtJoint),
    TopologyRule(JointTopology.TOPO_L, LMiterJoint)
]

# 4. Apply Rules using Solver
solver = JointRuleSolver(rules)
solver.apply_rules_to_model(model)

# 5. Process Joinery
model.process_joinery()

# 6. Extract Geometry
geo = [beam.geometry for beam in model.beams]
# ---------- end ct_model_4 ----------
# exercise
compas_draw_4 = COMPASDraw(cg=ct_model_4)  # -> rg; same code as compas_draw

# ----
# A00 Compas Timber - Ungraded
# Gramazio Kohler Research
# Gonzalo Casas, Lorin Wiedemeier, Eric Gozzi
# COMPAS Timber Model - From Lines
centerline_model = Line([Line((-3.509972934, -1.492152993, 2.22874718), (-3.509972934, -0.4188767486, 3.073171606)), Line((-3.509972934, -1.492152993, 2.22874718), (-2.4270184, -1.492152993, 3.073686963)), Line((-3.509972934, -0.1606205973, 3.23041945), (-2.161675054, -0.7695668304, 3.659802426)), Line((-3.509972934, -0.4188767486, 3.073171606), (-3.509972934, 0.9424020442, 3.701431926)), Line((-3.509972934, 1.253299248, 3.775463882), (-2.148966267, 0.3799502445, 4.128895601)), Line((-3.509972934, 0.9424020442, 3.701431926), (-3.509972934, 1.989048229, 3.84778377))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])
ct_from_lines = Python3Script(
    lines=centerline_model,
    beam_width=Slider(0.08, range=0..0.1),
    beam_height=Slider(0.1, range=0..0.1),
    process_joinery=Toggle(True))  # -> beams; inputs lines: list of Line, beam_width: Double, beam_height: Double, process_joinery: Boolean
# ---------- ct_from_lines: Python ----------
# r: compas==2.15.0,compas_timber==1.0.4
# venv: ca-fs26

from compas_rhino.devtools import DevTools
DevTools.ensure_path()

# --------------------------------------------------
# ------------------- YOUR CODE --------------------
from compas_rhino.conversions import line_to_compas
from a00_timber_model import TimberModelCreator

# 1. Convert Rhino lines to COMPAS lines
#lines = 
lines = [line_to_compas(l) for l in lines]
# 2. Instantiate the TimberModelCreator with input lines and dimensions
# creator = 
creator = TimberModelCreator(lines, beam_width, beam_height)
# 3. Create the timber model (and optionally process joinery)
# timber_model = 
timber_model = creator.create_timber_model(process_joinery=True)
# 4. Extract beam geometry for visualization in Rhino/Grasshopper
# beams = 
beams = [element.geometry for element in timber_model.elements()]
# ---------- end ct_from_lines ----------
# assignment
compas_draw_5 = COMPASDraw(cg=ct_from_lines)  # -> rg; same code as compas_draw

reloader = CompasDevReloader()
# ---------- reloader: Python ----------
"""
------------------------------
Using VS Code as Python editor
------------------------------

The simplest way to start using VS Code as our editor, is
to place our Python code in files located IN THE SAME FOLDER as our Grasshopper file.

After we have done that, we need 2 steps: 

1. Enable the COMPAS reloader on one component. This tells Grasshopper to watch for changes in the Pythoh files and reload if changed.
2. Every other component that uses Python code from external files needs to start with a method to ensure Grasshopper knows where to load the files from.

"""
# r: compas==2.15.0,compas_timber==1.0.4
# venv: ca-fs26

from compas_rhino.devtools import DevTools
DevTools.enable_reloader()
# ---------- end reloader ----------
