# Grasshopper definition a01_brep-mesher.ghx (Grasshopper 1.0.8)
# Copyright: Lorin Wiedemeier

# ----
# Brep Meshing
list = ValueList({"TriRemesh": "tri", "QuadRemesh": "quad", "HexaRemesh": "hexa"}, selected="TriRemesh")
srf = Geometry(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)
py_compas = CompasPyTemplate(mesher_type=list, u_count=Slider(8, range=1..30), v_count=Slider(9, range=1..30), brep=srf, full_faces=Toggle(False))  # -> mesh, geo; inputs mesher_type: String, u_count: Int32, v_count: Int32, brep: Brep
# ---------- py_compas: Python ----------
# r: compas==2.15.0,compas_timber==1.0.4
# venv: ca-fs26

from compas_rhino.devtools import DevTools
DevTools.ensure_path()
ghenv.Component.Message = "Mesher"

# ------ IMPORTS -------

from compas_rhino.conversions import mesh_to_rhino

# MAIN TASK: Let's import our QuadMesher
from a01_mesher import QuadMesher
from a01_mesher import TriMesher
# CHALLENGE 02: Add other imports if you implemented new classes
# from a01_mesher import ...

# --------------------------------------------------
# ------------------- EXECUTION --------------------
mesher = None
compas_mesh = None
# MAIN TASK
# Step 1: if mesher_type is "quad", use your QuadMesher to create a mesh
if mesher_type == "quad":
    mesher = QuadMesher(u_count=u_count, v_count=v_count, brep=brep, full_quads = full_faces)
# ...

# CHALLENGE 02: if you add one or more variants of meshing, create the instance of the 
# elif mesher_type ...
elif mesher_type == "tri":
    mesher = TriMesher(u_count=u_count, v_count=v_count, brep=brep)

# Step 2: Generate the mesh
mesher.generate_mesh()
compas_mesh = mesher.mesh
# Step 3: Prepare output (mesh & rhino geometry)
mesh = compas_mesh
geo = mesh_to_rhino(compas_mesh)
# ---------- end py_compas ----------
geometry = Geometry(py_compas.geo)

srf_trim = Geometry(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)

# ----
# RF System
compas_mesh = Data(py_compas.mesh)
# A01 Brep Mesh
# Gramazio Kohler Research
# Gonzalo Casas, Lorin Wiedemeier, Eric Gozzi
py_compas_2 = CompasPyTemplate(mesh=compas_mesh, eccentricity=Slider(0.243, range=-1..1), extensions=Slider(0.19, range=-1..1))  # -> rf_system, mesh, centerlines; inputs eccentricity: Double
# ---------- py_compas_2: Python ----------
# r: compas==2.15.0,compas_timber==1.0.4
# venv: ca-fs26

from compas_rhino.devtools import DevTools
DevTools.ensure_path()
ghenv.Component.Message = "RF Datastracture and lines"

# ------ IMPORTS -------

from a01_rf_system import RFSystem

# --------------------------------------------------
# ------------------- EXECUTION --------------------

# MAIN TASK:
# Step 1: create an rf system from mesh
# rf_system = ...
rf_system = RFSystem(mesh=mesh)
# Step 2: create RF datastructure
# ...
rf_system.create_rf_datastructure()
# Step 3: eccentrize and extend center lines
# ...
rf_system.eccentrize_centerlines(eccentricity)
rf_system.extend_centerlines(extensions)
# Step 4: Prepare output
# centerlines = ...
centerlines = rf_system.centerlines
# mesh = ...
mesh = rf_system.mesh
# ---------- end py_compas_2 ----------
draw = COMPASDraw(cg=py_compas_2.centerlines)  # -> rg
#   port cg: The COMPAS geometry or datastructure to be drawn.
#   port rg: The Rhino geometry object.
# ---------- draw: Python ----------
# r: compas==2.15.0,compas_timber==1.0.4
# venv: ca-fs26

from typing import Any

import Grasshopper

from compas.scene import SceneObject


class CompasToRhinoGeometry(Grasshopper.Kernel.GH_ScriptInstance):
    def RunScript(self, cg):
        if not cg:
            return None

        return SceneObject(item=cg).draw()
# ---------- end draw ----------

# ----
# Timber Model
dam = DataDam(DataA=py_compas_2.rf_system, BufferDelay=10000000, BufferMode=1)
py_compas_3 = CompasPyTemplate(
    rf_system=dam,
    process_joinery=Toggle(True),
    beam_width=Slider(0.08, range=0..0.2),
    beam_height=Slider(0.1, range=0..0.2),
    tolerance=Slider(0.17, range=0..0.5))  # -> timber_model, beams, joining_errors
# ---------- py_compas_3: Python ----------
# r: compas==2.15.0,compas_timber==1.0.4
# venv: ca-fs26

from compas_rhino.devtools import DevTools
DevTools.ensure_path()
ghenv.Component.Message = "Timber model"

# -------------------- IMPORTS ---------------------

from a01_timber_model import TimberModelCreator

# ------------------- EXECUTION --------------------

# Copy the RF system on start, because that's the way Grasshopper always behaves
rf_system = rf_system.copy()

# Initialize creator
creator = TimberModelCreator(rf_system, beam_width, beam_height, tolerance=tolerance)

# Create model and apply joints
timber_model = creator.create_timber_model(process_joinery=process_joinery)
for beam in timber_model.beams: print(beam.features)
joining_errors = creator.joining_errors

if len(joining_errors):
    ghenv.Component.Message = f"Found {len(joining_errors)} joining errors!"

# Output geometry
beams = []
for beam in timber_model.beams:
    beams.append(beam.geometry)
# ---------- end py_compas_3 ----------
draw_2 = COMPASDraw(cg=py_compas_3.beams)  # -> rg; same code as draw
wires = BrepWireframe(Brep=draw_2, Density=-1)
preview = CustomPreview(Geometry=draw_2, Material=ColourSwatch(SwatchColor=RGBA(214, 188, 139, 144)))
preview_2 = CustomPreview(Geometry=wires, Material=ColourSwatch(SwatchColor=RGB(0, 0, 0)))

reloader = CompasDevReloader()
# ---------- reloader: Python ----------
"""
------------------------------
Using VS Code as Python editor
------------------------------

The simplest way to start using VS Code as our editor, is
to place our Python code in files located IN THE SAME FOLDER as our Grasshopper file.

After we have done that, we need 2 steps: 

1. Enable the COMPAS reloader on one component. This tells Grasshopper to watch for changes in the Pythoh files and reload if changed.
2. Every other component that uses Python code from external files needs to start with a method to ensure Grasshopper knows where to load the files from.

"""
# r: compas==2.15.0,compas_timber==1.0.4
# venv: ca-fs26

from compas_rhino.devtools import DevTools
DevTools.enable_reloader()
# ---------- end reloader ----------
